% Simulink data dictionary export_enum_struct.sldd

export_struct_t = Simulink.Bus(DataScope="Exported", HeaderFile="export_struct.h")
  data: single
  num: uint32

EXPORT_ENUM_T = enum(DataScope="Exported", HeaderFile="export_enum.h", DefaultValue="value0")
  value0 = 0
  value1 = 1
  value2 = 2

Sig = Simulink.Signal()
export_sig = Simulink.Signal(StorageClass="ExportToFile", HeaderFile="export_struct.h", DataType="Bus: export_struct_t")
export_param = Simulink.Parameter([], StorageClass="ExportToFile", HeaderFile="export_struct.h", DataType="Bus: export_struct_t")