% Simulink data dictionary modelref.sldd

shared_data_in = Simulink.Signal(DataType="uint32", InitialValue="0")
shared_data_out = Simulink.Signal(DataType="uint32", InitialValue="0")
shared_mask = Simulink.Signal(DataType="uint32", InitialValue="0")
shared_error = Simulink.Signal(DataType="uint32", InitialValue="0")
shared_param = Simulink.Parameter([0 1 2 3 4 5 6 7 8 9], DataType="uint8")

shared_bus_t = Simulink.Bus()
  data: uint8[100]
  size: uint32